# Grasshopper definition PneuMesh_Animation_Tets.gh (Grasshopper 1.0.7)
# plug-ins: Kangaroo2 Components

real_channel = BooleanToggle(True)
not = GateNot(A=real_channel)
merge = Merge(Data1=real_channel, Data2=not)
merge_2 = Merge(Data1="0", Data2="0.98")
merge_3 = Merge(Data1=ColourSwatch(SwatchColor=RGB(66, 66, 66)), Data2=ColourSwatch(SwatchColor=RGB(255, 254, 254)))
json_dirs = Panel("""single_tet_0.json
single_tet_1.json
single_tet_2.json
single_tet_3.json
single_tet_4.json
single_tet_5.json""")
merge_4 = Merge(Data1="0", Data2="0.9")
vb = VBScript()  # -> out, A
# ---------- vb: VB ----------
    Dim gh_d As GH_Document = owner.OnPingDocument()

    If gh_d.IsFilePathDefined Then
      Print("A path is defined.")
      A = gh_d.FilePath
    Else
      Print("No path defined.")
    End If
# ---------- end vb ----------
dispatch = Dispatch(List=merge_2, DispatchPattern=merge)  # -> ListA, ListB
merge_5 = Merge(Data1=ColourSwatch(SwatchColor=RGB(255, 255, 255)), Data2=ColourSwatch(SwatchColor=RGB(255, 254, 254)))
dispatch_2 = Dispatch(List=merge_3, DispatchPattern=merge)  # -> ListA, ListB
json_dirs_2 = Panel("""tet_0.json
tet_1.json
tet_2.json
tet_3.json
tet_4.json""")
merge_6 = Merge(Data1="0.2", Data2="0.9")
dispatch_3 = Dispatch(List=merge_4, DispatchPattern=merge)  # -> ListA, ListB
dispatch_4 = Dispatch(List=merge_5, DispatchPattern=merge)  # -> ListA, ListB
dispatch_5 = Dispatch(List=merge_6, DispatchPattern=merge)  # -> ListA, ListB
python = GhPythonScript(json_dirs=json_dirs, curr_dir=vb.A, t=Slider(0, range=0..1))  # -> out, prev, r_channel_joint, r_joint, pistons, shells, joints, blockers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
# ---------- python: Python ----------
__author__ = "Roll"

import rhinoscriptsyntax as rs
import json
import os

json_dirs = json_dirs.split()
cdr = os.path.dirname(curr_dir)
json_dirs = [os.path.join(cdr, dir) for dir in json_dirs]
datas = [json.load(open(dir)) for dir in json_dirs]

len_pairs = len(datas) - 1
dt_pair = 1 / len_pairs

t = 0.9999 if t == 1 else t
i_data_init = int(t // dt_pair)
t = (t % dt_pair) / dt_pair

data_init = datas[i_data_init]
data_final = datas[i_data_init + 1]
data_contraction = data_final if i_data_init % 2 == 0 else data_init

e = data_init['e']
inflatChannel = data_init['inflateChannel']
edgeChannel = data_init['edgeChannel']
v0 = [rs.AddPoint(v) for v in data_init['v']]
v1 = [rs.AddPoint(v) for v in data_final['v']]
v_contraction = [rs.AddPoint(v) for v in data_contraction['v']]

vec0 = rs.PointSubtract(v1[3], v1[2])
l0 = rs.VectorLength(vec0)
l0 =   1.71429268781

l_piston = (l0 / 2) * 0.8
l_shell = l_piston
l_joint = (l0 - l_piston - l_shell) / 2 * 1.1
l_blocker = l_piston * 0.1

r_piston = l0 * 0.08 / 2
r_shell = r_piston * 1.25
r_joint = r_piston * 0.83
r_channel = r_piston * 0.7
r_blocker = r_shell * 1.05
r_channel_joint = r_joint * 0.6


v = [  
    rs.PointAdd(
        rs.PointScale(v0[i], 1 - t), 
        rs.PointScale(v1[i], t)
    )
    for i in range(len(v0))
]

joints = [{'pos': vertex, 'channels': {}} for vertex in v]
# joints = [ { 'pos': rs.Point,
#        'channels': { ic0: [p0, p1, p2], ic1: [p0, p1]}  }]    


pistons = []
shells = []
channels = dict()   # {ic0: [channel, channel, jointChannel]}
blockers = []


def addShell(vs, ve, r_out):
    vec = rs.PointSubtract(ve, vs)
    pln = rs.PlaneFromNormal(vs, vec)
    out_circle = rs.AddCircle(pln, r_out)
    in_circle = rs.AddCircle(pln, r_out * 0.85)
    ring = rs.AddPlanarSrf([out_circle, in_circle])[0]
    shell = rs.ExtrudeSurface(ring, rs.AddLine(vs, ve), True)
    return shell

def getBeamGeometry(v, ee):
    v0 = v[ee[0]]
    v1 = v[ee[1]]
    vec = rs.PointSubtract(v1, v0)
    vec_unit = rs.VectorUnitize(vec)
    vec_joint = rs.VectorScale(vec_unit, l_joint)
    vec_piston = rs.VectorScale(vec_unit, l_piston)
    vec_shell = rs.VectorScale(vec_unit, l_shell)
    
    vs_piston = rs.PointAdd(v0, vec_joint)
    ve_piston = rs.PointAdd(vs_piston, vec_piston)
    
    ve_shell = rs.PointSubtract(v1, vec_joint)
    vs_shell = rs.PointSubtract(ve_shell, vec_shell)
    
    vs_blocker = rs.PointSubtract(vs_shell, rs.VectorScale(vec_unit, l_blocker))
    l_blocker_to_vs_piston = rs.VectorLength(rs.PointSubtract(vs_blocker, vs_piston))
    
    return vs_piston, ve_piston, ve_shell, vs_shell, vec_unit, l_blocker_to_vs_piston


for ie, ee in enumerate(e):
    vs_piston, ve_piston, ve_shell, vs_shell, vec_unit, _ = getBeamGeometry(v, ee)
    _, _, _, _, _, l_blocker_to_vs_piston = getBeamGeometry(v_contraction, ee)
    
    piston = addShell(vs_piston, ve_piston, r_piston)
    shell = addShell(vs_shell, ve_shell, r_shell)
    
    vs_blocker = rs.PointAdd(vs_piston, rs.VectorScale(vec_unit, l_blocker_to_vs_piston))
    ve_blocker = rs.PointAdd(vs_blocker, rs.VectorScale(vec_unit, l_blocker))
    
    blocker = addShell(vs_blocker, ve_blocker, r_blocker)
    channel = rs.AddPipe(rs.AddLine(vs_piston, ve_shell), 0, r_channel, cap=2)
    
    pistons.append(piston)
    shells.append(shell)
    blockers.append(blocker)
    ic = edgeChannel[ie]
    if ic not in channels:
        channels[ic] = []
    channels[ic] += channel
    
    # joint
    joint0 = joints[ee[0]]
    joint1 = joints[ee[1]]
    if ic not in joint0['channels']:
        joint0['channels'][ic] = []
    joint0['channels'][ic].append(vs_piston)
    
    if ic not in joint1['channels']:
        joint1['channels'][ic] = []
    joint1['channels'][ic].append(ve_shell)
    

lines_channels = [
    [],
    [],
    [],
    []
]
lines_joints = [

]

for joint in joints:
    p = joint['pos']
    ics = joint['channels'].keys()
    cs = joint['channels']
    
    for ic in ics:  # each channel
        lines_ic = []
        ps_ic = cs[ic]
        for p_ic in ps_ic:
            line = rs.AddLine(p_ic, p)
            lines_joints.append(line)
            if len(ps_ic) == 1:
                vec = rs.PointSubtract(p, p_ic)
                vec = rs.VectorScale(vec, 0.5)
                p_e = rs.PointAdd(p_ic, vec)
                line = rs.AddLine(p_ic, p_e)
            lines_channels[ic].append(line)
    

multiPipes_0 = lines_channels[0]
multiPipes_1 = lines_channels[1]
multiPipes_2 = lines_channels[2]
multiPipes_3 = lines_channels[3]

if 0 in channels: channels_0 = channels[0]
if 1 in channels: channels_1 = channels[1]
if 2 in channels: channels_2 = channels[2]
if 3 in channels: channels_3 = channels[3]

channelOn_0 = inflatChannel[0]
channelOn_1 = inflatChannel[1]
channelOn_2 = inflatChannel[2]
channelOn_3 = inflatChannel[3]

joints = lines_joints
# ---------- end python ----------
pistons = CreateMaterial(
    Diffuse=ColourSwatch(SwatchColor=RGB(255, 254, 254)),
    Specular=RGB(0, 0, 0),
    Emission=RGB(0, 0, 0),
    Transparency=dispatch.ListA,
    Shine="100")
joints = CreateMaterial(Diffuse=dispatch_4.ListA, Specular=RGB(255, 254, 254), Emission=RGB(0, 0, 0), Transparency=dispatch_5.ListA, Shine=0)
shells = CreateMaterial(Diffuse=dispatch_2.ListA, Specular=RGB(255, 254, 254), Emission=RGB(0, 0, 0), Transparency=dispatch_3.ListA, Shine=0)
col = Colour(RGB(140, 140, 140))
merge_7 = Merge(Data1=python.channelOn_0, Data2=python.channelOn_1, Data3=python.channelOn_2, Data4=python.channelOn_3)
blockers = CreateMaterial(Diffuse=col, Specular=RGB(255, 254, 254), Emission=RGB(0, 0, 0), Transparency=0, Shine=0)
panel = Panel(merge_7)
preview = CustomPreview(Geometry=python.blockers, Material=blockers)
mp = MultiPipe(Curves=python.joints, NodeSize=python.r_joint, EndOffset=1, StrutSize=1, Segment=0, KinkAngle=0.6, CubeFit=0, Caps=0)
preview_2 = CustomPreview(Geometry=python.shells, Material=shells)
preview_3 = CustomPreview(Geometry=python.pistons, Material=pistons)
preview_4 = CustomPreview(Geometry=mp, Material=joints)
mp_2 = MultiPipe(
    Curves=python.multiPipes_0,
    NodeSize=python.r_channel_joint,
    EndOffset="0",
    StrutSize="1",
    Segment=0,
    KinkAngle=0.6,
    CubeFit=0,
    Caps="2")
mp_3 = MultiPipe(
    Curves=python.multiPipes_1,
    NodeSize=python.r_channel_joint,
    EndOffset="0",
    StrutSize="1",
    Segment=0,
    KinkAngle=0.6,
    CubeFit=0,
    Caps="2")
merge_8 = Merge(Data1="1", Data2="0.7")
mp_4 = MultiPipe(
    Curves=python.multiPipes_2,
    NodeSize=python.r_channel_joint,
    EndOffset="0",
    StrutSize="1",
    Segment=0,
    KinkAngle=0.6,
    CubeFit=0,
    Caps="2")
dispatch_6 = Dispatch(List=merge_8, DispatchPattern=merge)  # -> ListA, ListB
trigger = Trigger(Interval=1000, TimerInterval=1000, Target=rec)  # disabled
channeltransparencymodifier = GhPythonScript(
    channelOn_0=python.channelOn_0,
    channelOn_1=python.channelOn_1,
    channelOn_2=python.channelOn_2,
    channelOn_3=python.channelOn_3)  # -> out, delta_0, delta_1, delta_2, delta_3
# ---------- channeltransparencymodifier: Python ----------
__author__ = "Roll"

import rhinoscriptsyntax as rs

channelOns = [channelOn_0, channelOn_1, channelOn_2, channelOn_3]

deltas = [0 if channelOn else 0.26 for channelOn in channelOns]

delta_0, delta_1, delta_2, delta_3 = deltas
# ---------- end channeltransparencymodifier ----------
rec = DataRecorder("0", DataLimit=-10, RecordData=True)
lng = ListLength(List=rec)
addition = Addition(A=channeltransparencymodifier.delta_0, B=dispatch_6.ListA)
addition_2 = Addition(A=channeltransparencymodifier.delta_1, B=dispatch_6.ListA)
addition_3 = Addition(A=channeltransparencymodifier.delta_2, B=dispatch_6.ListA)
addition_4 = Addition(A=channeltransparencymodifier.delta_3, B=dispatch_6.ListA)
division = Division(A=lng, B="100")
panel_2 = Panel("100")
merge_9 = Merge(Data1=mp_4, Data2=python.channels_2)
merge_10 = Merge(Data1=mp_3, Data2=python.channels_1)
merge_11 = Merge(Data1=mp_2, Data2=python.channels_0)
c0 = CreateMaterial(
    Diffuse=ColourSwatch(SwatchColor=RGB(54, 145, 191)),
    Specular=RGB(255, 254, 254),
    Emission=RGB(0, 0, 0),
    Transparency=addition,
    Shine=0)
c1 = CreateMaterial(
    Diffuse=ColourSwatch(SwatchColor=RGB(237, 218, 43)),
    Specular=RGB(255, 254, 254),
    Emission=RGB(0, 0, 0),
    Transparency=addition_2,
    Shine=0)
c2 = CreateMaterial(
    Diffuse=ColourSwatch(SwatchColor=RGB(89, 158, 16)),
    Specular=RGB(0, 0, 0),
    Emission=RGB(0, 0, 0),
    Transparency=addition_3,
    Shine=0)
c3 = CreateMaterial(
    Diffuse=ColourSwatch(SwatchColor=RGB(183, 79, 214)),
    Specular=RGB(255, 254, 254),
    Emission=RGB(0, 0, 0),
    Transparency=addition_4,
    Shine=0)
preview_5 = CustomPreview(Geometry=merge_11, Material=c0)
preview_6 = CustomPreview(Geometry=merge_10, Material=c1)
preview_7 = CustomPreview(Geometry=merge_9, Material=c2)
preview_8 = CustomPreview(Geometry=python.channels_3, Material=c3)
